# Grasshopper definition Clayvengers_compas_fab_03.gh (Grasshopper 1.0.7)
# plug-ins: Volvox, Heteroptera, Kangaroo2 Components, Human

# SCANNING
path = FilePath("C:\Users\kchadha\Downloads\clayvengers_00.e57")
percentage = Panel("50")
loade57 = LoadE57(FilePath=path, Index=-1, Percent=percentage, Run=Toggle(False), Abort=False, Check=False)  # -> Cloud, Pose
yz = YZPlane(Origin=Point(0, 0, 0))
vec = VectorXYZ(XComponent=Slider(-1.12, range=-2..2), YComponent=Slider(-0.077, range=-1..1), ZComponent=Slider(0.38, range=-1..1))  # -> Vector, Length
bbox = BoundingBox(Content=loade57.Cloud, Plane=PlaneXY(0, 0, 0), UnionBox=True)  # -> Box, Box_2
clo = Cloud(loade57.Cloud)
move = Move(Geometry=yz, Motion=vec.Vector)  # -> Geometry, Transform
center = Center(Geometric=bbox.Box)  # -> Center, Dimension
Z = UnitZ(Factor=1)
rot3d = Rotate3D(Geometry=move.Geometry, Angle=degrees(Slider(1.899, range=-180..180)), Center=move.Geometry, Axis=Z)  # -> Geometry, Transform
orient = Orient(Geometry=clo, Source=center.Center, Target=rot3d.Geometry)  # -> Geometry, Transform
clo_2 = Cloud(orient.Geometry)

vec_2 = VectorXYZ(XComponent=Slider(1.09, range=-1..2), YComponent=Slider(0, range=-1..1), ZComponent=Slider(0, range=-1..1))  # -> Vector, Length
rsub = RandomSubsampling(Percent=Slider(4, range=0..10), Seed=123)
yz_2 = YZPlane(Origin=vec_2.Vector)
Z_2 = UnitZ(Factor=1)
rot3d_2 = Rotate3D(Geometry=yz_2, Angle=degrees(Slider(-10, range=-10..10)), Center=yz_2, Axis=Z_2)  # -> Geometry, Transform
cloude = CloudEngine(Cloud=clo_2, Instruction0=rsub)
sec = CloudPlane(Cloud=cloude, Plane=rot3d_2.Geometry, Tolerance=0.001, Project=False)
decloud = DeconstructCloud(Cloud=sec)  # -> Points, Normals, Colors
pdecon = Deconstruct(Point=decloud.Points)  # -> XComponent, YComponent, ZComponent
sort = SortList(Keys=pdecon.XComponent, ValuesA=decloud.Points)  # -> Keys, ValuesA
pline = PolyLine(Vertices=sort.ValuesA, Closed=False)  # disabled
dots = DotDisplay(Point=decloud.Points, Colour=RGB(0, 0, 0), Size=0.02)  # disabled

panel = Panel("830.67")  # disabled
panel_2 = Panel("1180.88")  # disabled
panel_3 = Panel("667.16")  # disabled
panel_4 = Panel("684.87")  # disabled
panel_5 = Panel("121.38")  # disabled
panel_6 = Panel("125.04")  # disabled
panel_7 = Panel("763.19")  # disabled
panel_8 = Panel("-559.49")  # disabled
panel_9 = Panel("127.68")  # disabled
neg = Negative(Value=panel_5)  # disabled
neg_2 = Negative(Value=panel_9)  # disabled
neg_3 = Negative(Value=panel_6)  # disabled
pt = ConstructPoint(XCoordinate=expr("x/1000", panel), YCoordinate=expr("x/1000", panel_4), ZCoordinate=expr("x/1000", neg))  # disabled
pt_2 = ConstructPoint(XCoordinate=expr("x/1000", panel_2), YCoordinate=expr("x/1000", panel_3), ZCoordinate=expr("x/1000", neg_3))  # disabled
pt_3 = ConstructPoint(XCoordinate=expr("x/1000", panel_7), YCoordinate=expr("x/1000", panel_8), ZCoordinate=expr("x/1000", neg_2))  # disabled
neg_4 = Negative(Value=pt_3)  # disabled
neg_5 = Negative(Value=pt)  # disabled
neg_6 = Negative(Value=pt_2)  # disabled
dot = DotDisplay(Point=[neg_5, neg_6, neg_4])  # disabled
number_slider = Slider(-0.1073, range=-0.1073..0)  # disabled
number_slider_2 = Slider(0.198, range=0.198..1)  # disabled
number_slider_3 = Slider(-0.057, range=-0.0571..0)  # disabled
neg_7 = Negative(Value=number_slider_3)  # disabled
pt_4 = ConstructPoint(XCoordinate=number_slider, YCoordinate=number_slider_2, ZCoordinate=neg_7)  # disabled
X = UnitX(Factor=1)

mesh = Mesh([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])
mjoin = MeshJoin(Meshes=flatten(mesh))

Y = UnitY(Factor=1)
pln = Plane([Plane(origin=(0.9826211954, 0.2543432205, 0.7575755418), x=(0.02294393911, -0.001280331591, 0.9997359333), y=(-0.2330906183, -0.9724463586, 0.004104046903)), Plane(origin=(1.031230411, 0.242687059, 0.7564450326), x=(0.02294393911, -0.001280331591, 0.9997359333), y=(-0.2330906183, -0.9724463586, 0.004104046903)), Plane(origin=(1.028506575, 0.2351407871, 0.7259388098), x=(0.02776653215, -0.001549444849, 0.9996132347), y=(-0.2643555151, -0.9644075695, 0.005848201447)), Plane(origin=(1.025269034, 0.227239435, 0.6957206333), x=(0.03316070549, -0.001850453778, 0.9994483195), y=(-0.294281228, -0.9556854327, 0.007994531841)), Plane(origin=(1.017420835, 0.2060146168, 0.6737309457), x=(0.04857275695, -0.002710486412, 0.9988159693), y=(-0.3214352923, -0.9468414521, 0.01306206333)), Plane(origin=(1.008960665, 0.185009101, 0.6517653295), x=(0.06381322436, -0.003560944207, 0.9979555061), y=(-0.3202868453, -0.9471662489, 0.01710069241))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])
pln_2 = Plane([Plane(origin=(0.9609040987, 0.2035851882, 0.6287471202), x=(0.06272635815, -0.003500294241, 0.9980246249), y=(-0.3380640493, -0.9409519597, 0.0179473707)), Plane(origin=(1.007855619, 0.1866590873, 0.6257368295), x=(0.06272635815, -0.003500294241, 0.9980246249), y=(-0.3380640493, -0.9409519597, 0.0179473707)), Plane(origin=(1.000634524, 0.16971074, 0.6071628509), x=(0.07397230731, -0.004127847509, 0.9972517529), y=(-0.3168974907, -0.9482576429, 0.01958118957)), Plane(origin=(0.993894129, 0.1536399343, 0.587662488), x=(0.08322662516, -0.004644262561, 0.996519824), y=(-0.2922936734, -0.956120381, 0.01995559087)), Plane(origin=(0.9878700556, 0.1395860244, 0.566454856), x=(0.09019272409, -0.005032989033, 0.9959116133), y=(-0.2696951978, -0.9627470827, 0.01955901387)), Plane(origin=(0.9826656742, 0.1284808488, 0.5433695471), x=(0.09496363134, -0.005299218091, 0.9954666378), y=(-0.2518406167, -0.9675846644, 0.01887381918))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])
rotate = Rotate(Geometry=pln, Angle=degrees("180"), Plane=PlaneXY(0, 0, 0))  # -> Geometry, Transform

group = Group(Objects=rotate.Geometry)
bbox_2 = BoundingBox(Content=group, Plane=PlaneXY(0, 0, 0), UnionBox=True)  # -> Box, Box_2
area = Area(Geometry=bbox_2.Box)  # -> Area, Centroid
scale_nu = ScaleNU(Geometry=group, Plane=area.Centroid, ScaleX=1, ScaleY=Slider(1.2, range=0..10), ScaleZ=1)  # -> Geometry, Transform
Z_3 = UnitZ(Factor=1)
rot3d_3 = Rotate3D(Geometry=scale_nu.Geometry, Angle=degrees("-1.5"), Center=area.Centroid, Axis=Z_3)  # -> Geometry, Transform
ungroup = Ungroup(Group=rot3d_3.Geometry)

vec_3 = VectorXYZ(XComponent=Slider(0.13, range=0..1), YComponent=Slider(-0.06, range=-1..1), ZComponent=Slider(-0.19, range=-0.19..1))  # -> Vector, Length
move_2 = Move(Geometry=ungroup, Motion=vec_3.Vector)  # -> Geometry, Transform

dot_2 = DotDisplay(Point=move_2.Geometry)
pline_2 = PolyLine(Vertices=move_2.Geometry, Closed=False)
prot = RotatePlane(Plane=move_2.Geometry, Angle=degrees(Slider(-180, range=-180..180)))
pline_3 = PolyLine(Vertices=ungroup, Closed=False)
previewlw = CustomPreviewLineweights(Geometry=pline_3, Shader=ColourSwatch(SwatchColor=RGB(255, 0, 251)), Thickness=Slider(12, range=0..100), Absolute=False)

number_slider_4 = Slider(-0.057, range=-0.0571..0)  # disabled
number_slider_5 = Slider(-0.1073, range=-0.1073..0)  # disabled
number_slider_6 = Slider(0.198, range=0.198..1)  # disabled
neg_8 = Negative(Value=number_slider_4)  # disabled
pt_5 = ConstructPoint(XCoordinate=number_slider_5, YCoordinate=number_slider_6, ZCoordinate=neg_8)  # disabled

# ---- group: left_top
panel_10 = Panel("-278.68")

# ----
neg_9 = Negative(Value=panel_10)

# ---- group: left_top (continued)
pt_6 = ConstructPoint(XCoordinate=expr("x/1000", "825.12"), YCoordinate=expr("x/1000", "681.71"), ZCoordinate=expr("x/1000", neg_9))

# ----
neg_10 = Negative(Value=pt_6)

# ---- group: left_bottom
panel_11 = Panel("-274.22")

# ----
neg_11 = Negative(Value=panel_11)

# ---- group: left_bottom (continued)
pt_7 = ConstructPoint(XCoordinate=expr("x/1000", "1172.85"), YCoordinate=expr("x/1000", "665.13"), ZCoordinate=expr("x/1000", neg_11))

# ----
neg_12 = Negative(Value=pt_7)

# ---- group: right_bottom
panel_12 = Panel("-271.60")

# ----
neg_13 = Negative(Value=panel_12)

# ---- group: right_bottom (continued)
pt_8 = ConstructPoint(XCoordinate=expr("x/1000", "760.70"), YCoordinate=expr("x/1000", "-557.85"), ZCoordinate=expr("x/1000", neg_13))

# ----
neg_14 = Negative(Value=pt_8)
dot_3 = DotDisplay(Point=[neg_10, neg_12, neg_14])

# ----
# FINISHING
# Robotic planning
button = Button()
ur10e = GhPythonScript(load=button)  # -> robot
# ---------- ur10e: Python ----------
import os

import compas_fab
from compas.artists import Artist
from compas.geometry import Frame
from compas.robots import RobotModel
from compas.robots.resources import LocalPackageMeshLoader
from compas_fab.backends import AnalyticalInverseKinematics
from compas_fab.backends import OffsetWristKinematics
from compas_fab.backends.interfaces import ClientInterface
from compas_fab.robots import Robot
from compas_fab.robots import RobotSemantics


canvas = ghenv.Component.OnPingDocument()

urdf_folder = os.path.join(os.path.dirname(canvas.FilePath), '../data/robots')
urdf_file = os.path.join(urdf_folder, 'ur10e.urdf')
srdf_file = os.path.join(urdf_folder, 'ur10e.srdf')

model = RobotModel.from_urdf_file(urdf_file)
model.load_geometry(LocalPackageMeshLoader(urdf_folder, 'ur_description'))

semantics = RobotSemantics.from_srdf_file(srdf_file, model)

client = ClientInterface()
client.is_connected = True
client.inverse_kinematics = AnalyticalInverseKinematics(solver='ur10e')

robot = Robot(model, client=client, semantics=semantics)
robot.artist = Artist(model)
# ---------- end ur10e ----------
pt_9 = ConstructPoint(
    XCoordinate=Slider(0.1, range=0..1),
    YCoordinate=Slider(0.19, range=0..1),
    ZCoordinate=expr("-x", Slider(0.05, range=0..1)))
toggle = BooleanToggle(False)

xy = XYPlane(Origin=pt_9)
rot3d_4 = Rotate3D(Geometry=xy, Angle=degrees(Slider(-37, range=-180..180)), Center=xy, Axis=X)  # -> Geometry, Transform
rot3d_5 = Rotate3D(Geometry=rot3d_4.Geometry, Angle=degrees(Slider(180, range=-180..180)), Center=Point(0, 0, 0), Axis=Y)  # -> Geometry, Transform

tool = COMPASFABAttachedTool(robot=ur10e, visual_mesh=mjoin, tcf_plane=rot3d_5.Geometry)  # -> robot; inputs visual_mesh: Mesh, collision_mesh: Mesh
#   port visual_mesh: A visual mesh for the tool.
#   port collision_mesh: A collision mesh for the tool.
#   port tcf_plane: The frame of the tool in tool0 frame.
#   port group: The planning group to which the tool should be attached.
# ---------- tool: Python ----------
"""
Attach a tool to the robot.

COMPAS FAB v0.26.0
"""
from ghpythonlib.componentbase import executingcomponent as component
from compas_rhino.conversions import RhinoMesh
from compas_rhino.conversions import plane_to_compas_frame

from compas.geometry import Frame
from compas_fab.robots import Tool


class AttachToolComponent(component):
    def RunScript(self, robot, visual_mesh, collision_mesh, tcf_plane, group):
        if robot and robot.client and robot.client.is_connected and visual_mesh:
            if not collision_mesh:
                collision_mesh = visual_mesh

            c_visual_mesh = RhinoMesh.from_geometry(visual_mesh).to_compas()
            c_collision_mesh = RhinoMesh.from_geometry(collision_mesh).to_compas()

            if not tcf_plane:
                frame = Frame.worldXY()
            else:
                frame = plane_to_compas_frame(tcf_plane)
            tool = Tool(c_visual_mesh, frame, c_collision_mesh)

            robot.attach_tool(tool, group)

        return robot
# ---------- end tool ----------

robot_ip = Panel("192.168.56.101")

move_to_config = GhPythonScript(send=Button(), ip=robot_ip)  # -> config
# ---------- move_to_config: Python ----------
__author__ = "kchadha"
__version__ = "2022.11.18"

import rhinoscriptsyntax as rs

import os
import math
from scriptcontext import sticky as st

from compas.rpc import Proxy
from compas_fab.ghpython.components import create_id

key = create_id(ghenv.Component, 'get_config')

if send:
    canvas = ghenv.Component.OnPingDocument()
    path = os.path.abspath(os.path.dirname(canvas.FilePath))
    rtde = Proxy('fabrication', path=path)
#    nowait = False
    st[key] = rtde.get_config(ip=ip)
    print rtde.get_config(ip=ip)
    ghenv.Component.Message = "Config received"
    config = st.get(key)
#config_degrees =  ['{:.2f}'.format(math.degrees(r)) for r in config.joint_values]
#print ['{:.2f}'.format(math.degrees(r)) for r in place_config.joint_values]
# ---------- end move_to_config ----------
rec = DataRecorder(move_to_config, DataLimit=-10, RecordData=True)
clean = CleanTree(RemoveNulls=True, RemoveInvalid=True, RemoveEmpty=False, Tree=rec)
panel_13 = Panel(clean)
python = GhPythonScript(robot=tool, place_frames=prot, start_config=clean)  # -> out, place_configs, place_configs_degrees; inputs place_frames: list
# ---------- python: Python ----------
__author__ = "kchadha"
__version__ = "2022.11.12"


import math
import rhinoscriptsyntax as rs
import compas_rhino.conversions as crc
#from compas_rhino.conversions import RhinoPlane
from compas_fab.backends import AnalyticalPlanCartesianMotion

if robot and robot.client:
    place_frames = [crc.plane_to_compas_frame(f) for f in place_frames]
    start_configuration = robot.zero_configuration()
    start_config = start_configuration
    if start_config:
        start_configuration.joint_values = start_config.joint_values
    planner = AnalyticalPlanCartesianMotion(robot.client)
    trajectory = planner.plan_cartesian_motion(robot, place_frames, start_configuration, options={'keep_order': True})
    place_configs = trajectory.points
#    place_config = place_configs[0]
# ---------- end python ----------
lng = ListLength(List=python.place_configs)
multiplication = Multiplication(A=lng, B=Slider(0, range=0..1))
item = ListItem(List=python.place_configs, Index=multiplication, Wrap=True)

robot_visualize = COMPASFABRobotVisualize(robot=tool, configuration=item, show_cm=toggle, show_acm=toggle)  # -> visual, collision, collision_meshes, attached_meshes, frames, base_frame, ee_frame; inputs show_visual: Boolean, show_collision: Boolean, show_frames: Boolean, show_base_frame: Boolean, show_end_effector_frame: Boolean, show_cm: Boolean, show_acm: Boolean
#   port group: The planning group used for end-effector and base visualization.
#   port configuration: The robot's full configuration.
#   port show_visual: Whether or not to show the robot's visual meshes.
#   port show_collision: Whether or not to show the robot's collision meshes.
#   port show_frames: Whether or not to show the robot's joint frames.
#   port show_base_frame: Whether or not to show the robot's base frame.
#   port show_end_effector_frame: Whether or not to show the robot's end-effector frame.
#   port show_cm: Whether or not to show the collision meshes (if any).
#   port show_acm: Whether or not to show the attached collision meshes (if any).
#   port visual: Rhino meshes of the robot's visual geometry (if any).
#   port collision: Rhino meshes of the robot's collision geometry (if any).
#   port collision_meshes: Rhino meshes of the scene's collision meshes (if any).
#   port attached_meshes: Rhino meshes of the scene's attached collision meshes (if any).
#   port frames: The robot's joint frames as Rhino planes (if any).
#   port base_frame: The robot's base frame as a Rhino plane (if any).
#   port ee_frame: The robot's end-effector frame as a Rhino plane (if any).
# ---------- robot_visualize: Python ----------
"""
Visualizes the robot.

COMPAS FAB v0.27.0
"""
from compas.artists import Artist
from compas.geometry import Frame
from compas.geometry import Transformation
from compas_fab.robots import PlanningScene
from ghpythonlib.componentbase import executingcomponent as component


class RobotVisualize(component):
    def RunScript(
        self,
        robot,
        group,
        configuration,
        show_visual,
        show_collision,
        show_frames,
        show_base_frame,
        show_end_effector_frame,
        show_cm,
        show_acm,
    ):

        visual = None
        collision = None
        collision_meshes = None
        attached_meshes = None
        frames = None
        base_frame = None
        ee_frame = None

        if robot:
            show_visual = True if show_visual is None else show_visual
            show_cm = True if show_cm is None else show_cm
            show_acm = True if show_acm is None else show_acm
            configuration = configuration or robot.zero_configuration()

            robot.update(configuration, visual=show_visual, collision=show_collision)
            compas_frames = robot.transformed_frames(configuration, group)

            if show_visual:
                visual = robot.artist.draw_visual()

            if show_collision:
                collision = robot.artist.draw_collision()

            if show_base_frame:
                base_compas_frame = compas_frames[0]
                artist = Artist(base_compas_frame)
                base_frame = artist.draw()

            if show_end_effector_frame:
                ee_compas_frame = robot.forward_kinematics(
                    configuration, group, options=dict(solver="model")
                )
                artist = Artist(ee_compas_frame)
                ee_frame = artist.draw()

            if show_frames:
                frames = []
                for compas_frame in compas_frames[1:]:
                    artist = Artist(compas_frame)
                    frame = artist.draw()
                    frames.append(frame)

            if show_cm or show_acm:
                scene = PlanningScene(robot)
                scene = robot.client.get_planning_scene()

                collision_meshes = []
                attached_meshes = []

                if show_cm:
                    for co in scene.world.collision_objects:
                        header = co.header
                        frame_id = header.frame_id
                        cms = co.to_collision_meshes()

                        for cm in cms:
                            if cm.frame != Frame.worldXY():
                                t = Transformation.from_frame(cm.frame)
                                mesh = cm.mesh.transformed(t)
                            else:
                                mesh = cm.mesh

                            collision_meshes.append(Artist(mesh).draw())

                if show_acm:
                    for aco in scene.robot_state.attached_collision_objects:
                        for acm in aco.to_attached_collision_meshes():
                            frame_id = aco.object["header"]["frame_id"]
                            frame = robot.forward_kinematics(
                                configuration, options=dict(link=frame_id)
                            )
                            t = Transformation.from_frame(frame)

                            # Local CM frame
                            if (
                                acm.collision_mesh.frame
                                and acm.collision_mesh.frame != Frame.worldXY()
                            ):
                                t = t * Transformation.from_frame(
                                    acm.collision_mesh.frame
                                )

                            mesh = acm.collision_mesh.mesh.transformed(t)

                            attached_meshes.append(Artist(mesh).draw())

        return (
            visual,
            collision,
            collision_meshes,
            attached_meshes,
            frames,
            base_frame,
            ee_frame,
        )
# ---------- end robot_visualize ----------

move_to_config_2 = GhPythonScript(
    config=python.place_configs,
    speed=Slider(0.2, range=0..2),
    accel=Slider(0.1, range=0..3.14),
    send=Button(),
    ip=robot_ip,
    blend=Slider(0.01, range=0..0.1))  # -> a; inputs config: list
# ---------- move_to_config_2: Python ----------
__author__ = "kchadha"
__version__ = "2022.11.18"


import os
import math

from compas.rpc import Proxy

if send:
    if not config:
        ghenv.Component.Message = "No config to move to!"
    else:
        canvas = ghenv.Component.OnPingDocument()
        path = os.path.abspath(os.path.dirname(canvas.FilePath))
        rtde = Proxy('fabrication', path=path)
#        nowait = False
#        a = rtde.move_to_joints(config, speed, accel, nowait, ip=ip)
        a = rtde.move_trajectory(config,speed, accel, blend, ip=ip)
        ghenv.Component.Message = "Sent config"
# ---------- end move_to_config_2 ----------
panel_14 = Panel(move_to_config_2)
