# Grasshopper definition iaac_ws_robot.gh (Grasshopper 1.0.7)

get_config = GhPythonScript(send=Button(), ip="127.0.0.1")  # -> config
# ---------- get_config: Python ----------
import os
from scriptcontext import sticky as st
from compas.rpc import Proxy

config_key = 'config_{}'.format(str(ghenv.Component.InstanceGuid))
if config_key not in st:
    st[config_key] = None

if send:
    canvas = ghenv.Component.OnPingDocument()
    path = os.path.abspath(os.path.dirname(canvas.FilePath))
    rtde = Proxy('fabrication', path=path)
    
    st[config_key] = rtde.get_config(ip=ip)

config = st[config_key]
# ---------- end get_config ----------
move_to_config = GhPythonScript(speed=Slider(0.24, range=0..2), accel=Slider(0.1, range=0..3.14), send=Button(), ip="127.0.0.1")  # -> a
# ---------- move_to_config: Python ----------
import os
import math

from compas.rpc import Proxy

if send:
    if not config:
        ghenv.Component.Message = "No config to move to!"
    else:
        canvas = ghenv.Component.OnPingDocument()
        path = os.path.abspath(os.path.dirname(canvas.FilePath))
        rtde = Proxy('fabrication', path=path)
        nowait = True
        a = rtde.move_to_joints(config, speed, accel, nowait, ip=ip)
        ghenv.Component.Message = "Sent config"
# ---------- end move_to_config ----------
